# Grasshopper definition gears.gh (Grasshopper 1.0.7)

teeth_number = Slider(21, range=1..101)
rotation = Slider(0, range=0..360)
teeth_number_2 = GetInteger(teeth_number, AtLeast=1, AtMost=1, Maximum=2147483647, Minimum=-2147483648)
rotation_2 = GetInteger(rotation, AtLeast=1, AtMost=1, Maximum=2147483647, Minimum=-2147483648)

# ----
# Teeth # 1
panel = Panel("2")
multiplication = Multiplication(A=teeth_number_2, B=panel)

width = Panel("20")
value_btw_in_out = Addition(A=width, B=Slider(1.5, range=0..2))

# ----
# Shape # 1
pt = ConstructPoint(XCoordinate=0, YCoordinate=0, ZCoordinate=0)
pt_2 = ConstructPoint(XCoordinate=0, YCoordinate=0, ZCoordinate=0)
outer = Circle(Plane=pt, Radius=value_btw_in_out)
inner = Circle(Plane=pt_2, Radius=width)

inner_hole = OffsetCurve(Curve=outer, Distance=expr("-x", 10), Corners=1)

# ----
# Gap # 1 & 2
panel_2 = Panel("2")
multiplication_2 = Multiplication(A=value_btw_in_out, B=panel_2)
subtraction = Subtraction(A=multiplication_2, B="1")
Y = UnitY(Factor=subtraction)

# ----
# Gap # 1 & 2
panel_3 = Panel("2")
multiplication_3 = Multiplication(A=value_btw_in_out, B=panel_3)
subtraction_2 = Subtraction(A=multiplication_3, B="1")
X = UnitX(Factor=subtraction_2)

# ----
# Teeth # 1
teeth_division = DivideCurve(Curve=inner, Count=multiplication, Kinks=False)  # -> Points, Tangents, Parameters
teeth_division_2 = DivideCurve(Curve=outer, Count=teeth_number_2, Kinks=False)  # -> Points, Tangents, Parameters
panel_4 = Panel("""0
1""")
cull = CullPattern(List=teeth_division.Points, CullPattern=panel_4)
weave = Weave(Pattern=[0, 1], Stream0=teeth_division_2.Points, Stream1=cull, NullGaps=False)

# ---- group: 1st
pline = PolyLine(Vertices=weave, Closed=invert(False))

# ----
# Move + Rotation # 2
default_set = Slider(26, range=0..360)
move = Move(Geometry=pline, Motion=Y)  # -> Geometry, Transform
area = Area(Geometry=move.Geometry)  # -> Area, Centroid
line = LineSDL(Start=area.Centroid, Direction=Vector(0, 0, 1), Length=1)
addition = Addition(A=rotation_2, B=default_set)
_2nd_rot = Rotate3D(Geometry=move.Geometry, Angle=degrees(addition), Center=area.Centroid, Axis=line)  # -> Geometry, Transform

# ----
# Move + Rotation # 2
move_2 = Move(Geometry=pline, Motion=X)  # -> Geometry, Transform
area_2 = Area(Geometry=move_2.Geometry)  # -> Area, Centroid
line_2 = LineSDL(Start=area_2.Centroid, Direction=Vector(0, 0, 1), Length=1)
_2nd_rot_2 = Rotate3D(Geometry=move_2.Geometry, Angle=degrees(rotation_2), Center=area_2.Centroid, Axis=line_2)  # -> Geometry, Transform

# ----
# Rotation # 1
area_3 = Area(Geometry=pline)  # -> Area, Centroid
line_3 = LineSDL(Start=area_3.Centroid, Direction=Vector(0, 0, 1), Length=1)
neg = Negative(Value=rotation_2)
_1st_rot = Rotate3D(Geometry=pline, Angle=degrees(neg), Center=area_3.Centroid, Axis=line_3)  # -> Geometry, Transform

addition_2 = Addition(B="180")
fillet = Slider(0, range=0..1)

# ----
# Depth # 1
panel_5 = Panel("7")
fillet_2 = Fillet(Curve=_1st_rot.Geometry, Radius=fillet)
Z = UnitZ(Factor=panel_5)
crv = Curve(inner_hole)
boundary = BoundarySurfaces(Edges=[crv, fillet_2])
extr = Extrude(Base=[crv, fillet_2], Direction=Z)
move_3 = Move(Geometry=boundary, Motion=Z)  # -> Geometry, Transform
join = BrepJoin(Breps=[boundary, extr, move_3.Geometry])  # -> Breps, Closed

# ----
# Depth # 2
move_4 = Move(Geometry=inner_hole, Motion=X)  # -> Geometry, Transform
fillet_3 = Fillet(Curve=_2nd_rot_2.Geometry, Radius=fillet)
Z_2 = UnitZ(Factor=panel_5)
boundary_2 = BoundarySurfaces(Edges=[move_4.Geometry, fillet_3])
move_5 = Move(Geometry=boundary_2, Motion=Z_2)  # -> Geometry, Transform
extr_2 = Extrude(Base=[move_4.Geometry, fillet_3], Direction=Z_2)
join_2 = BrepJoin(Breps=[extr_2, move_5.Geometry, boundary_2])  # -> Breps, Closed

# ----
# Depth # 2
fillet_4 = Fillet(Curve=_2nd_rot.Geometry, Radius=fillet)
Z_3 = UnitZ(Factor=panel_5)
move_6 = Move(Geometry=inner_hole, Motion=Y)  # -> Geometry, Transform
boundary_3 = BoundarySurfaces(Edges=[move_6.Geometry, fillet_4])
extr_3 = Extrude(Base=[move_6.Geometry, fillet_4], Direction=Z_3)
move_7 = Move(Geometry=boundary_3, Motion=Z_3)  # -> Geometry, Transform
join_3 = BrepJoin(Breps=[extr_3, move_7.Geometry, boundary_3])  # -> Breps, Closed

mesh = MeshBrep(
    Brep=[join_2.Breps, join.Breps, join_3.Breps],
    Settings={GridMaxCount=0, GridMinCount=16, JaggedSeams=False, MaxEdgeLength=0, MinEdgeLength=0.0001, MinTolerance=0, Refine=True, RefineAngle=0, RelativeTolerance=0.65, SimplePlanes=True, Tolerance=0})
mcol = MeshColours(Mesh=mesh, Colours=ColourSwatch(SwatchColor=RGB(191, 191, 191)))

# ---- group: RH_OUT:mesh
mesh_2 = Mesh(flatten(mcol))
