# Grasshopper definition gears.gh (Grasshopper 1.0.7)

teeth_number = Slider(21, range=1..101)
rotation = Slider(155, range=0..360)
teeth_number_2 = GetInteger(teeth_number, AtLeast=1, AtMost=1, Maximum=2147483647, Minimum=-2147483648)
rotation_2 = GetInteger(rotation, AtLeast=1, AtMost=1, Maximum=2147483647, Minimum=-2147483648)

pt = ConstructPoint(XCoordinate=0, YCoordinate=0, ZCoordinate=0)
pt_2 = ConstructPoint(XCoordinate=0, YCoordinate=0, ZCoordinate=0)
addition = Addition(A="20", B=Slider(1.5, range=0..2))
multiplication = Multiplication(A=teeth_number_2, B="2")
cir = Circle(Plane=pt, Radius=addition)
cir_2 = Circle(Plane=pt_2, Radius="20")
panel = Panel("20")
multiplication_2 = Multiplication(A=addition, B="2")
offset = OffsetCurve(Curve=cir, Distance=expr("-x", 10), Corners=1)
subtraction = Subtraction(A=multiplication_2, B="1")
divide = DivideCurve(Curve=cir_2, Count=multiplication, Kinks=False)  # -> Points, Tangents, Parameters
divide_2 = DivideCurve(Curve=cir, Count=teeth_number_2, Kinks=False)  # -> Points, Tangents, Parameters
panel_2 = Panel("""0
1""")
cull = CullPattern(List=divide.Points, CullPattern=panel_2)
weave = Weave(Pattern=[0, 1], Stream0=divide_2.Points, Stream1=cull, NullGaps=False)
pline = PolyLine(Vertices=weave, Closed=invert(False))
smooth = SmoothNumbers(Numbers=rotation_2, SmoothDelay=2000)
X = UnitX(Factor=subtraction)
move = Move(Geometry=pline, Motion=X)  # -> Geometry, Transform
neg = Negative(Value=smooth)
area = Area(Geometry=move.Geometry)  # -> Area, Centroid
line = LineSDL(Start=area.Centroid, Direction=Vector(0, 0, 1), Length=1)
area_2 = Area(Geometry=pline)  # -> Area, Centroid
line_2 = LineSDL(Start=area_2.Centroid, Direction=Vector(0, 0, 1), Length=1)
number_slider = Slider(0.4, range=0..1)
rot3d = Rotate3D(Geometry=move.Geometry, Angle=degrees(smooth), Center=area.Centroid, Axis=line)  # -> Geometry, Transform
rot3d_2 = Rotate3D(Geometry=pline, Angle=degrees(neg), Center=area_2.Centroid, Axis=line_2)  # -> Geometry, Transform

fillet = Fillet(Curve=rot3d_2.Geometry, Radius=number_slider)
Z = UnitZ(Factor=Slider(7, range=0..100))
crv = Curve(offset)
boundary = BoundarySurfaces(Edges=[crv, fillet])
extr = Extrude(Base=[crv, fillet], Direction=Z)
move_2 = Move(Geometry=boundary, Motion=Z)  # -> Geometry, Transform
join = BrepJoin(Breps=[boundary, extr, move_2.Geometry])  # -> Breps, Closed

move_3 = Move(Geometry=offset, Motion=X)  # -> Geometry, Transform
fillet_2 = Fillet(Curve=rot3d.Geometry, Radius=number_slider)
boundary_2 = BoundarySurfaces(Edges=[move_3.Geometry, fillet_2])
Z_2 = UnitZ(Factor=Slider(5, range=0..100))
move_4 = Move(Geometry=boundary_2, Motion=Z_2)  # -> Geometry, Transform
extr_2 = Extrude(Base=[move_3.Geometry, fillet_2], Direction=Z_2)
join_2 = BrepJoin(Breps=[extr_2, move_4.Geometry, boundary_2])  # -> Breps, Closed

wires = BrepWireframe(Brep=[join.Breps, join_2.Breps], Density=-1)
mesh = MeshBrep(
    Brep=[join_2.Breps, join.Breps],
    Settings={GridMaxCount=0, GridMinCount=16, JaggedSeams=False, MaxEdgeLength=0, MinEdgeLength=0.0001, MinTolerance=0, Refine=True, RefineAngle=0, RelativeTolerance=0.65, SimplePlanes=True, Tolerance=0})
mcol = MeshColours(Mesh=mesh, Colours=ColourSwatch(SwatchColor=RGB(255, 255, 255)))

# ---- group: RH_OUT:mesh
mesh_2 = Mesh(flatten(mcol))
